# Grasshopper definition auto_polyconical.gh (Grasshopper 1.0.7)

number_slider = Slider(8, range=0..20)
pt = Point(<point referenced from the Rhino model>)
xz = XZPlane(Origin=pt)
polygon = Polygon(Plane=xz, Radius=Slider(5, range=0..10), Segments=number_slider, FilletRadius=0)  # -> Polygon, Length
expression = Expression(x=number_slider, Expression="(x/2)+1")
expression_2 = Expression(x=number_slider, Expression="(x/2)+1")
explode = Explode(Curve=polygon.Polygon, Recursive=True)  # -> Segments, Vertices
points = PointList(Points=explode.Vertices)
int = Integer(1)
expression_3 = Expression(x=number_slider, Expression="(x/2)")
shift = ShiftList(List=explode.Segments, Shift=int, Wrap=True)
int_2 = Integer(1)
int_3 = Integer(1)
mirror_seg_2 = ListItem(List=explode.Segments, Index=expression, Wrap=True)
mirror_seg_1 = ListItem(List=explode.Segments, Index=int_2, Wrap=True)
revaxis_pt_2 = ListItem(List=explode.Vertices, Index=expression_2, Wrap=True)
revaxis_pt_1 = ListItem(List=explode.Vertices, Index=int_3, Wrap=True)
split = SplitList(List=shift, Index=expression_3)  # -> ListA, ListB
rev_axis = Line(StartPoint=revaxis_pt_1, EndPoint=revaxis_pt_2)
join = JoinCurves(Curves=split.ListA, Preserve=False)
int_4 = Integer(2)
divide = DivideCurve(Curve=mirror_seg_1, Count=int_4, Kinks=False)  # -> Points, Tangents, Parameters
divide_2 = DivideCurve(Curve=mirror_seg_2, Count=int_4, Kinks=False)  # -> Points, Tangents, Parameters
expression_4 = Expression(Expression="2*π")
item = ListItem(List=divide.Points, Index=1, Wrap=True)
points_2 = PointList(Points=divide.Points)
boundary = BoundarySurfaces(Edges=polygon.Polygon)
item_2 = ListItem(List=divide_2.Points, Index=1, Wrap=True)
revsrf = Revolution(Curve=join, Axis=rev_axis, Domain=expression_4)
vec2pt = Vector2Pt(PointA=item, PointB=item_2, Unitize=False)  # -> Vector, Length
split_2 = SplitBrep(Brep=revsrf, Cutter=boundary)
pl = PlaneNormal(Origin=pt, ZAxis=vec2pt.Vector)
brep0 = ListItem(List=split_2, Index=0, Wrap=True)
brep1 = ListItem(List=split_2, Index=1, Wrap=True)
mirror = Mirror(Geometry=brep1, Plane=pl)  # -> Geometry, Transform
ins = InsertItems(List=brep0, Item=mirror.Geometry, Indices=1, Wrap=True)
join_2 = BrepJoin(Breps=ins)  # -> Breps, Closed
